# Dynamo graph DuctFittingAreaDIN.dyn (Dynamo 0.8.1.1942)

family_types = FamilyTypes()
all_elements_of_family_type = ElementsOfFamilyType(family_types)
code_block = CodeBlock { "Area"; }
code_block_2 = CodeBlock { "a"; }
getParameterValueByName = Element.GetParameterValueByName(element=all_elements_of_family_type, parameterName=code_block_2)
convert_between_units = DynamoConvert(getParameterValueByName, conversionMetric=Length, conversionFrom=Feet, conversionTo=Millimeters)
code_block_3 = CodeBlock { "b"; }
getParameterValueByName_2 = Element.GetParameterValueByName(element=all_elements_of_family_type, parameterName=code_block_3)
convert_between_units_2 = DynamoConvert(getParameterValueByName_2, conversionMetric=Length, conversionFrom=Feet, conversionTo=Millimeters)
code_block_4 = CodeBlock(a=convert_between_units, b=convert_between_units_2) { a+b; }
code_block_5 = CodeBlock { "h"; }
getParameterValueByName_3 = Element.GetParameterValueByName(element=all_elements_of_family_type, parameterName=code_block_5)
convert_between_units_3 = DynamoConvert(getParameterValueByName_3, conversionMetric=Length, conversionFrom=Feet, conversionTo=Millimeters)
code_block_6 = CodeBlock { "d"; }
getParameterValueByName_4 = Element.GetParameterValueByName(element=all_elements_of_family_type, parameterName=code_block_6)
convert_between_units_4 = DynamoConvert(getParameterValueByName_4, conversionMetric=Length, conversionFrom=Feet, conversionTo=Millimeters)
code_block_7 = CodeBlock(c=convert_between_units_3, d=convert_between_units_4) { c+d; }
ge = code_block_4 >= code_block_7
boolean = BoolSelector(true)
formula = Formula("a=b", ge, boolean)
code_block_8 = CodeBlock(a=convert_between_units, b=convert_between_units_2) { 2*(a+b); }
code_block_9 = CodeBlock { "l2"; }
getParameterValueByName_5 = Element.GetParameterValueByName(element=all_elements_of_family_type, parameterName=code_block_9)
convert_between_units_5 = DynamoConvert(getParameterValueByName_5, conversionMetric=Length, conversionFrom=Feet, conversionTo=Millimeters)
code_block_10 = CodeBlock(l=convert_between_units_5) { l; }
code_block_11 = CodeBlock(u=code_block_8, l=code_block_10) { u*l; }
code_block_12 = CodeBlock { 0; }
if_ = If(test=formula, true=code_block_11, false=code_block_12)
watch = Watch(if_)
formula_2 = Formula("a=0")
filter = List.Filter(watch, formula_2)
watch_2 = Watch(filter.out1)
code_block_13 = CodeBlock(a=convert_between_units, b=convert_between_units_2) { a+b; }
code_block_14 = CodeBlock(c=convert_between_units_3, d=convert_between_units_4) { c+d; }
lt = code_block_13 < code_block_14
formula_3 = Formula("a=b", lt, boolean)
code_block_15 = CodeBlock(c=convert_between_units_3, d=convert_between_units_4) { 2*(c+d); }
code_block_16 = CodeBlock(l=convert_between_units_5) { l; }
code_block_17 = CodeBlock(u=code_block_15, l=code_block_16) { u*l; }
code_block_18 = CodeBlock { 0; }
if_2 = If(test=formula_3, true=code_block_17, false=code_block_18)
watch_3 = Watch(if_2)
formula_4 = Formula("a=0")
filter_2 = List.Filter(watch_3, formula_4)
watch_4 = Watch(filter_2.out1)
join = List.Join(watch_2, watch_4)
code_block_19 = CodeBlock { "x1"; }
getParameterValueByName_6 = Element.GetParameterValueByName(element=all_elements_of_family_type, parameterName=code_block_19)
convert_between_units_6 = DynamoConvert(getParameterValueByName_6, conversionMetric=Length, conversionFrom=Feet, conversionTo=Millimeters)
code_block_20 = CodeBlock { "r1"; }
getParameterValueByName_7 = Element.GetParameterValueByName(element=all_elements_of_family_type, parameterName=code_block_20)
convert_between_units_7 = DynamoConvert(getParameterValueByName_7, conversionMetric=Length, conversionFrom=Feet, conversionTo=Millimeters)
m = Formula("b+\"e\"+r-d", convert_between_units_2, convert_between_units_6, convert_between_units_7, convert_between_units_4)
formula_5 = Formula("d+m-b>=m", d=convert_between_units_4, m=m, b=convert_between_units_2)
boolean_2 = BoolSelector(true)
formula_6 = Formula("a=b", formula_5, boolean_2)
code_block_21 = CodeBlock(g=convert_between_units, h=convert_between_units_3) { 2*(g+h); }
code_block_22 = CodeBlock(d=convert_between_units_4, m=m, b=convert_between_units_2) { d+m-b; }
code_block_23 = CodeBlock(u=code_block_21, l=code_block_22) { u*l; }
code_block_24 = CodeBlock { 0; }
if_3 = If(test=formula_6, true=code_block_23, false=code_block_24)
watch_5 = Watch(if_3)
formula_7 = Formula("a=0")
filter_3 = List.Filter(watch_5, formula_7)
watch_6 = Watch(filter_3.out1)
formula_8 = Formula("d+m-b<m", d=convert_between_units_4, m=m, b=convert_between_units_2)
formula_9 = Formula("a=b", formula_8, boolean_2)
code_block_25 = CodeBlock(m=m) { m; }
code_block_26 = CodeBlock(u=code_block_21, l=code_block_25) { u*l; }
code_block_27 = CodeBlock { 0; }
if_4 = If(test=formula_9, true=code_block_26, false=code_block_27)
watch_7 = Watch(if_4)
formula_10 = Formula("a=0")
filter_4 = List.Filter(watch_7, formula_10)
watch_8 = Watch(filter_4.out1)
join_2 = List.Join(watch_6, watch_8)
formula_11 = Formula("a+b", a=join, b=join_2)
watch_9 = Watch(formula_11)
setParameterByName = Element.SetParameterByName(element=all_elements_of_family_type, parameterName=code_block, value=watch_9)
code_block_28 = CodeBlock { "h"; }
getParameterValueByName_8 = Element.GetParameterValueByName(element=all_elements_of_family_type, parameterName=code_block_28)
convert_between_units_8 = DynamoConvert(getParameterValueByName_8, conversionMetric=Length, conversionFrom=Feet, conversionTo=Millimeters)
code_block_29 = CodeBlock(b=convert_between_units_2, d=convert_between_units_4) { (b-d)/2; }
code_block_30 = CodeBlock(e=code_block_29) { e; }
code_block_31 = CodeBlock(a=convert_between_units, d=convert_between_units_4) { (a-d)/2; }
code_block_32 = CodeBlock(f=code_block_31) { f; }
n = Formula("r+\"e\"", arg1=convert_between_units_7)
watch_10 = Watch(filter.out0)
watch_11 = Watch(filter_2.out0)
watch_12 = Watch(filter_3.out0)
watch_13 = Watch(filter_4.out0)
re_bogen_symetrisch = FamilyTypes("RE Bogen BS - Flansch:Allgemein")
all_elements_of_family_type_2 = ElementsOfFamilyType(re_bogen_symetrisch)
code_block_33 = CodeBlock { "Area"; }
code_block_34 = CodeBlock { "a"; }
getParameterValueByName_9 = Element.GetParameterValueByName(element=all_elements_of_family_type_2, parameterName=code_block_34)
convert_between_units_9 = DynamoConvert(getParameterValueByName_9, conversionMetric=Length, conversionFrom=Feet, conversionTo=Millimeters)
code_block_35 = CodeBlock { "b"; }
getParameterValueByName_10 = Element.GetParameterValueByName(element=all_elements_of_family_type_2, parameterName=code_block_35)
convert_between_units_10 = DynamoConvert(getParameterValueByName_10, conversionMetric=Length, conversionFrom=Feet, conversionTo=Millimeters)
formula_12 = Formula("2*(a+b)", a=convert_between_units_9, b=convert_between_units_10)
code_block_36 = CodeBlock { "alpha"; }
getParameterValueByName_11 = Element.GetParameterValueByName(element=all_elements_of_family_type_2, parameterName=code_block_36)
code_block_37 = CodeBlock { "r"; }
getParameterValueByName_12 = Element.GetParameterValueByName(element=all_elements_of_family_type_2, parameterName=code_block_37)
convert_between_units_11 = DynamoConvert(getParameterValueByName_12, conversionMetric=Length, conversionFrom=Feet, conversionTo=Millimeters)
code_block_38 = CodeBlock { "e"; }
getParameterValueByName_13 = Element.GetParameterValueByName(element=all_elements_of_family_type_2, parameterName=code_block_38)
convert_between_units_12 = DynamoConvert(getParameterValueByName_13, conversionMetric=Length, conversionFrom=Feet, conversionTo=Millimeters)
code_block_39 = CodeBlock { "f"; }
getParameterValueByName_14 = Element.GetParameterValueByName(element=all_elements_of_family_type_2, parameterName=code_block_39)
convert_between_units_13 = DynamoConvert(getParameterValueByName_14, conversionMetric=Length, conversionFrom=Feet, conversionTo=Millimeters)
formula_13 = Formula("((c*3.14*(r+b))/180)+\"e\"+f;", getParameterValueByName_11, convert_between_units_11, convert_between_units_10, convert_between_units_12, convert_between_units_13)
mul = formula_12 * formula_13
area_mm_2 = Watch(mul)
convert_between_units_14 = DynamoConvert(area_mm_2, conversionMetric=Area, conversionFrom=SquareMillimeter, conversionTo=SquareMeter)
setParameterByName_2 = Element.SetParameterByName(element=all_elements_of_family_type_2, parameterName=code_block_33, value=convert_between_units_14)
re_ubergang_asymetrisch = FamilyTypes()
all_elements_of_family_type_3 = ElementsOfFamilyType(re_ubergang_asymetrisch)
code_block_40 = CodeBlock { "Area"; }
code_block_41 = CodeBlock { "a"; }
getParameterValueByName_15 = Element.GetParameterValueByName(element=all_elements_of_family_type_3, parameterName=code_block_41)
convert_between_units_15 = DynamoConvert(getParameterValueByName_15, conversionMetric=Length, conversionFrom=Feet, conversionTo=Millimeters)
code_block_42 = CodeBlock { "b"; }
getParameterValueByName_16 = Element.GetParameterValueByName(element=all_elements_of_family_type_3, parameterName=code_block_42)
convert_between_units_16 = DynamoConvert(getParameterValueByName_16, conversionMetric=Length, conversionFrom=Feet, conversionTo=Millimeters)
code_block_43 = CodeBlock(a=convert_between_units_15, b=convert_between_units_16) { a+b; }
PI = Math.PI()
code_block_44 = CodeBlock { "d1"; }
getParameterValueByName_17 = Element.GetParameterValueByName(element=all_elements_of_family_type_3, parameterName=code_block_44)
convert_between_units_17 = DynamoConvert(getParameterValueByName_17, conversionMetric=Length, conversionFrom=Feet, conversionTo=Millimeters)
code_block_45 = CodeBlock(p=PI, d=convert_between_units_17) { (p*d)/2; }
ge_2 = code_block_43 >= code_block_45
boolean_3 = BoolSelector(true)
code_block_46 = CodeBlock(a=convert_between_units_15, b=convert_between_units_16) { 2*(a+b); }
code_block_47 = CodeBlock { "l1"; }
getParameterValueByName_18 = Element.GetParameterValueByName(element=all_elements_of_family_type_3, parameterName=code_block_47)
convert_between_units_18 = DynamoConvert(getParameterValueByName_18, conversionMetric=Length, conversionFrom=Feet, conversionTo=Millimeters)
code_block_48 = CodeBlock(b=convert_between_units_16, d=convert_between_units_17) { (b-d)/2; }
code_block_49 = CodeBlock(e=code_block_48) { e; }
code_block_50 = CodeBlock(l=convert_between_units_18, e=code_block_49) { ((l*l)+(e*e)); }
sqrt = Math.Sqrt(code_block_50)
code_block_51 = CodeBlock(u=code_block_46, l=sqrt) { u*l; }
code_block_52 = CodeBlock { 0; }
formula_14 = Formula("if(a=b,c,d)", a=ge_2, b=boolean_3, c=code_block_51, d=code_block_52)
watch_14 = Watch(formula_14)
code_block_53 = CodeBlock(a=convert_between_units_15, b=convert_between_units_16) { a+b; }
code_block_54 = CodeBlock(p=PI, d=convert_between_units_17) { (p*d)/2; }
lt_2 = code_block_53 < code_block_54
code_block_55 = CodeBlock(p=PI, d=convert_between_units_17) { p*d; }
code_block_56 = CodeBlock(a=convert_between_units_15, d=convert_between_units_17) { (a-d)/2; }
code_block_57 = CodeBlock(f=code_block_56) { f; }
code_block_58 = CodeBlock(l=convert_between_units_18, f=code_block_57) { ((l*l)+(f*f)); }
sqrt_2 = Math.Sqrt(code_block_58)
code_block_59 = CodeBlock(u=code_block_55, l=sqrt_2) { u*l; }
formula_15 = Formula("if(a=b,c,d)", a=lt_2, b=boolean_3, c=code_block_59, d=code_block_52)
watch_15 = Watch(formula_15)
join_3 = List.Join(watch_14, watch_15)
code_block_60 = CodeBlock(a=join_3) { a>0; }
filterByBoolMask = List.FilterByBoolMask(list=join_3, mask=code_block_60)
watch_16 = Watch(filterByBoolMask.in)
watch_17 = Watch(watch_16)
setParameterByName_3 = Element.SetParameterByName(element=all_elements_of_family_type_3, parameterName=code_block_40, value=watch_17)
code_block_61 = CodeBlock { "c"; }
getParameterValueByName_19 = Element.GetParameterValueByName(element=all_elements_of_family_type_3, parameterName=code_block_61)
ge_3 = code_block_49 >= code_block_57
lt_3 = code_block_49 < code_block_57
max = Math.Max(code_block_51, code_block_59)
watch_18 = Watch(max)
watch_19 = Watch(filterByBoolMask.out)
ru_ubergang_symetrisch = FamilyTypes("RU Übergang - Gleitgelenk:Allgemein")
all_elements_of_family_type_4 = ElementsOfFamilyType(ru_ubergang_symetrisch)
code_block_62 = CodeBlock { "Area"; }
PI_2 = Math.PI()
code_block_63 = CodeBlock { "d1"; }
getParameterValueByName_20 = Element.GetParameterValueByName(element=all_elements_of_family_type_4, parameterName=code_block_63)
convert_between_units_19 = DynamoConvert(getParameterValueByName_20, conversionMetric=Length, conversionFrom=Feet, conversionTo=Millimeters)
code_block_64 = CodeBlock { "d3"; }
getParameterValueByName_21 = Element.GetParameterValueByName(element=all_elements_of_family_type_4, parameterName=code_block_64)
convert_between_units_20 = DynamoConvert(getParameterValueByName_21, conversionMetric=Length, conversionFrom=Feet, conversionTo=Millimeters)
code_block_65 = CodeBlock { "l1"; }
getParameterValueByName_22 = Element.GetParameterValueByName(element=all_elements_of_family_type_4, parameterName=code_block_65)
convert_between_units_21 = DynamoConvert(getParameterValueByName_22, conversionMetric=Length, conversionFrom=Feet, conversionTo=Millimeters)
code_block_66 = CodeBlock(pi=PI_2, d1=convert_between_units_19, d3=convert_between_units_20, l1=convert_between_units_21) { (((pi*d1)+(pi*d3))/2)*l1; }
convert_between_units_22 = DynamoConvert(code_block_66, conversionMetric=Area, conversionFrom=SquareMillimeter, conversionTo=SquareMeter)
setParameterByName_4 = Element.SetParameterByName(element=all_elements_of_family_type_4, parameterName=code_block_62, value=convert_between_units_22)
ru_bogen = FamilyTypes("RU Bogen - Gleitgelenk:1.0 a")
all_elements_of_family_type_5 = ElementsOfFamilyType(ru_bogen)
code_block_67 = CodeBlock { "Area"; }
PI_3 = Math.PI()
code_block_68 = CodeBlock { "d1"; }
getParameterValueByName_23 = Element.GetParameterValueByName(element=all_elements_of_family_type_5, parameterName=code_block_68)
convert_between_units_23 = DynamoConvert(getParameterValueByName_23, conversionMetric=Length, conversionFrom=Feet, conversionTo=Millimeters)
code_block_69 = CodeBlock { "Länge 1"; }
getParameterValueByName_24 = Element.GetParameterValueByName(element=all_elements_of_family_type_5, parameterName=code_block_69)
convert_between_units_24 = DynamoConvert(getParameterValueByName_24, conversionMetric=Length, conversionFrom=Feet, conversionTo=Millimeters)
code_block_70 = CodeBlock(pi=PI_3, d1=convert_between_units_23, l1=convert_between_units_24) { (pi*d1)*l1; }
setParameterByName_5 = Element.SetParameterByName(element=all_elements_of_family_type_5, parameterName=code_block_67, value=code_block_70)
re_bogen_asymetrich = FamilyTypes()
all_elements_of_family_type_6 = ElementsOfFamilyType(re_bogen_asymetrich)
code_block_71 = CodeBlock { "Area"; }
code_block_72 = CodeBlock { "b"; }
getParameterValueByName_25 = Element.GetParameterValueByName(element=all_elements_of_family_type_6, parameterName=code_block_72)
convert_between_units_25 = DynamoConvert(getParameterValueByName_25, conversionMetric=Length, conversionFrom=Feet, conversionTo=Millimeters)
code_block_73 = CodeBlock { "d"; }
getParameterValueByName_26 = Element.GetParameterValueByName(element=all_elements_of_family_type_6, parameterName=code_block_73)
convert_between_units_26 = DynamoConvert(getParameterValueByName_26, conversionMetric=Length, conversionFrom=Feet, conversionTo=Millimeters)
ge_4 = convert_between_units_25 >= convert_between_units_26
code_block_74 = CodeBlock { "alpha"; }
getParameterValueByName_27 = Element.GetParameterValueByName(element=all_elements_of_family_type_6, parameterName=code_block_74)
code_block_75 = CodeBlock { "r1"; }
getParameterValueByName_28 = Element.GetParameterValueByName(element=all_elements_of_family_type_6, parameterName=code_block_75)
convert_between_units_27 = DynamoConvert(getParameterValueByName_28, conversionMetric=Length, conversionFrom=Feet, conversionTo=Millimeters)
code_block_76 = CodeBlock { "e"; }
getParameterValueByName_29 = Element.GetParameterValueByName(element=all_elements_of_family_type_6, parameterName=code_block_76)
convert_between_units_28 = DynamoConvert(getParameterValueByName_29, conversionMetric=Length, conversionFrom=Feet, conversionTo=Millimeters)
code_block_77 = CodeBlock { "f"; }
getParameterValueByName_30 = Element.GetParameterValueByName(element=all_elements_of_family_type_6, parameterName=code_block_77)
convert_between_units_29 = DynamoConvert(getParameterValueByName_30, conversionMetric=Length, conversionFrom=Feet, conversionTo=Millimeters)
code_block_78 = CodeBlock { "a"; }
getParameterValueByName_31 = Element.GetParameterValueByName(element=all_elements_of_family_type_6, parameterName=code_block_78)
convert_between_units_30 = DynamoConvert(getParameterValueByName_31, conversionMetric=Length, conversionFrom=Feet, conversionTo=Millimeters)
code_block_79 = CodeBlock(alpha=getParameterValueByName_27, r=convert_between_units_27, b=convert_between_units_25, e=convert_between_units_28, f=convert_between_units_29, a=convert_between_units_30) { (((alpha*3.14*(r+b))/180)+e+f)*(2*(a+b)); }
code_block_80 = CodeBlock { "c"; }
getParameterValueByName_32 = Element.GetParameterValueByName(element=all_elements_of_family_type_6, parameterName=code_block_80)
convert_between_units_31 = DynamoConvert(getParameterValueByName_32, conversionMetric=Length, conversionFrom=Feet, conversionTo=Millimeters)
code_block_81 = CodeBlock(alpha=getParameterValueByName_27, r=convert_between_units_27, d=convert_between_units_26, e=convert_between_units_28, f=convert_between_units_29, c=convert_between_units_31) { ((((alpha*3.14*(r+d))/180)+e+f)*2*(c+d)); }
if_5 = If(test=ge_4, true=code_block_79, false=code_block_81)
watch_20 = Watch(if_5)
setParameterByName_6 = Element.SetParameterByName(element=all_elements_of_family_type_6, parameterName=code_block_71, value=watch_20)
code_block_82 = CodeBlock { RU-Ubergang US; }
code_block_83 = CodeBlock { TIM Template_Families; }
family_types_2 = FamilyTypes("RE Bogen BS - Flansch:Allgemein")
all_elements_of_family_type_7 = ElementsOfFamilyType(family_types_2)
code_block_84 = CodeBlock { "Area"; }
code_block_85 = CodeBlock { "a"; }
getParameterValueByName_33 = Element.GetParameterValueByName(element=all_elements_of_family_type_7, parameterName=code_block_85)
convert_between_units_32 = DynamoConvert(getParameterValueByName_33, conversionMetric=Length, conversionFrom=Feet, conversionTo=Millimeters)
code_block_86 = CodeBlock { "b"; }
getParameterValueByName_34 = Element.GetParameterValueByName(element=all_elements_of_family_type_7, parameterName=code_block_86)
convert_between_units_33 = DynamoConvert(getParameterValueByName_34, conversionMetric=Length, conversionFrom=Feet, conversionTo=Millimeters)
formula_16 = Formula("2*(a+b)", a=convert_between_units_32, b=convert_between_units_33)
code_block_87 = CodeBlock { "alpha"; }
getParameterValueByName_35 = Element.GetParameterValueByName(element=all_elements_of_family_type_7, parameterName=code_block_87)
code_block_88 = CodeBlock { "r"; }
getParameterValueByName_36 = Element.GetParameterValueByName(element=all_elements_of_family_type_7, parameterName=code_block_88)
convert_between_units_34 = DynamoConvert(getParameterValueByName_36, conversionMetric=Length, conversionFrom=Feet, conversionTo=Millimeters)
code_block_89 = CodeBlock { "e"; }
getParameterValueByName_37 = Element.GetParameterValueByName(element=all_elements_of_family_type_7, parameterName=code_block_89)
convert_between_units_35 = DynamoConvert(getParameterValueByName_37, conversionMetric=Length, conversionFrom=Feet, conversionTo=Millimeters)
code_block_90 = CodeBlock { "f"; }
getParameterValueByName_38 = Element.GetParameterValueByName(element=all_elements_of_family_type_7, parameterName=code_block_90)
convert_between_units_36 = DynamoConvert(getParameterValueByName_38, conversionMetric=Length, conversionFrom=Feet, conversionTo=Millimeters)
formula_17 = Formula("((c*3.14*(r+b))/180)+\"e\"+f;", getParameterValueByName_35, convert_between_units_34, convert_between_units_33, convert_between_units_35, convert_between_units_36)
mul_2 = formula_16 * formula_17
area_mm_2_2 = Watch(mul_2)
convert_between_units_37 = DynamoConvert(area_mm_2_2, conversionMetric=Area, conversionFrom=SquareMillimeter, conversionTo=SquareMeter)
setParameterByName_7 = Element.SetParameterByName(element=all_elements_of_family_type_7, parameterName=code_block_84, value=convert_between_units_37)
re_ubergang_symetrisch = FamilyTypes("CAx RE BA Bogen - Flansch:CAx Standard")
all_elements_of_family_type_8 = ElementsOfFamilyType(re_ubergang_symetrisch)
code_block_91 = CodeBlock { "Area"; }
code_block_92 = CodeBlock { "a"; }
getParameterValueByName_39 = Element.GetParameterValueByName(element=all_elements_of_family_type_8, parameterName=code_block_92)
convert_between_units_38 = DynamoConvert(getParameterValueByName_39, conversionMetric=Length, conversionFrom=Feet, conversionTo=Millimeters)
code_block_93 = CodeBlock { "b"; }
getParameterValueByName_40 = Element.GetParameterValueByName(element=all_elements_of_family_type_8, parameterName=code_block_93)
convert_between_units_39 = DynamoConvert(getParameterValueByName_40, conversionMetric=Length, conversionFrom=Feet, conversionTo=Millimeters)
code_block_94 = CodeBlock(a=convert_between_units_38, b=convert_between_units_39) { a+b; }
code_block_95 = CodeBlock { "c"; }
getParameterValueByName_41 = Element.GetParameterValueByName(element=all_elements_of_family_type_8, parameterName=code_block_95)
convert_between_units_40 = DynamoConvert(getParameterValueByName_41, conversionMetric=Length, conversionFrom=Feet, conversionTo=Millimeters)
code_block_96 = CodeBlock { "d"; }
getParameterValueByName_42 = Element.GetParameterValueByName(element=all_elements_of_family_type_8, parameterName=code_block_96)
convert_between_units_41 = DynamoConvert(getParameterValueByName_42, conversionMetric=Length, conversionFrom=Feet, conversionTo=Millimeters)
code_block_97 = CodeBlock(c=convert_between_units_40, d=convert_between_units_41) { c+d; }
ge_5 = code_block_94 >= code_block_97
boolean_4 = BoolSelector(true)
code_block_98 = CodeBlock(a=convert_between_units_38, b=convert_between_units_39) { 2*(a+b); }
code_block_99 = CodeBlock { "l1"; }
getParameterValueByName_43 = Element.GetParameterValueByName(element=all_elements_of_family_type_8, parameterName=code_block_99)
convert_between_units_42 = DynamoConvert(getParameterValueByName_43, conversionMetric=Length, conversionFrom=Feet, conversionTo=Millimeters)
code_block_100 = CodeBlock(b=convert_between_units_39, d=convert_between_units_41) { (b-d)/2; }
code_block_101 = CodeBlock(e=code_block_100) { e; }
code_block_102 = CodeBlock(l=convert_between_units_42, e=code_block_101) { ((l*l)+(e*e)); }
sqrt_3 = Math.Sqrt(code_block_102)
code_block_103 = CodeBlock(u=code_block_98, l=sqrt_3) { u*l; }
code_block_104 = CodeBlock { "Fehler"; }
formula_18 = Formula("if(a=b,c,d)", a=ge_5, b=boolean_4, c=code_block_103, d=code_block_104)
watch_21 = Watch(formula_18)
code_block_105 = CodeBlock(a=convert_between_units_38, b=convert_between_units_39) { a+b; }
code_block_106 = CodeBlock(c=convert_between_units_40, d=convert_between_units_41) { c+d; }
lt_4 = code_block_105 < code_block_106
code_block_107 = CodeBlock(c=convert_between_units_40, d=convert_between_units_41) { 2*(c+d); }
code_block_108 = CodeBlock(a=convert_between_units_38, c=convert_between_units_40) { (a-c)/2; }
code_block_109 = CodeBlock(f=code_block_108) { f; }
code_block_110 = CodeBlock(l=convert_between_units_42, f=code_block_109) { ((l*l)+(f*f)); }
sqrt_4 = Math.Sqrt(code_block_110)
code_block_111 = CodeBlock(u=code_block_107, l=sqrt_4) { u*l; }
formula_19 = Formula("if(a=b,c,d)", a=lt_4, b=boolean_4, c=code_block_111, d=code_block_104)
watch_22 = Watch(formula_19)
join_4 = List.Join(watch_21, watch_22)
eq = join_4 == code_block_104
filterByBoolMask_2 = List.FilterByBoolMask(list=join_4, mask=eq)
watch_23 = Watch(filterByBoolMask_2.out)
watch_24 = Watch(watch_23)
setParameterByName_8 = Element.SetParameterByName(element=all_elements_of_family_type_8, parameterName=code_block_91, value=watch_24)
lt_5 = code_block_101 < code_block_109
ge_6 = code_block_101 >= code_block_109
max_2 = Math.Max(code_block_103, code_block_111)
watch_25 = Watch(max_2)
