# Dynamo graph OffsetAnnotation.dyn (Dynamo 2.0.2.6826)

categories = Categories(index=320)
all_elements_of_category = ElementsOfCategory(Category=categories)
code_block = CodeBlock { "Versatz"; "OffsetAnnotation"; }
getParameterValueByName = Element.GetParameterValueByName(element=all_elements_of_category, parameterName=code_block.out0)
setParameterByName = Element.SetParameterByName(element=all_elements_of_category, parameterName=code_block.out1, value=getParameterValueByName)
