# Dynamo graph SelectionByParameter.dyn "Dynamo Selection" (Dynamo 2.0.0.4654)

# group: Elements in view
all_elements_in_active_view = ElementsInView()
watch = Watch(all_elements_in_active_view)

# group: Define parameters
code_block = CodeBlock { "BW.Beschreibung 1"; }
getParameterValueByName = Element.GetParameterValueByName(parameterName=code_block)  # unwired: element
code_block_2 = CodeBlock { "B"; }
eq = _ == code_block_2  # unwired: x

function_compose = ComposeFunctions(func0=getParameterValueByName, func1=eq)
watch_2 = Watch(function_compose)
groupByFunction = List.GroupByFunction(list=watch, func=watch_2)
firstLast = Custom[Springs.List.FirstLast](list=groupByFunction)  # Simple utility node to get both the first and last items of a list as separate outputs. This avoids the unnecessary sublist when using the List.Deconstruct node.

# group: Parameter check
watch_3 = Watch(firstLast.last)
code_block_3 = CodeBlock { "BW.Beschreibung 1"; }
getParameterValueByName_2 = Element.GetParameterValueByName(element=watch_3, parameterName=code_block_3)
watch_4 = Watch(getParameterValueByName_2)

# group: Selection in Revit
selectInRevit = Custom[Springs.SelectInRevit](element=watch_3)  # Selects the input elements inside the Revit UI.
watch_5 = Watch(selectInRevit)
